# Grasshopper definition rubik'sCube.gh (Grasshopper 1.0.7)
# plug-ins: Bifocals, Anemone

number_slider = Slider(2, range=0..10)
number_slider_2 = Slider(1, range=0..1)
sqgrid = Square(Plane=PlaneXY(0, 0, 0), Size=number_slider_2, ExtentX=number_slider, ExtentY=number_slider)  # -> Cells, Points
Z = UnitZ(Factor=number_slider_2)
arrlinear = LinearArray(Geometry=sqgrid.Points, Direction=Z, Count=Slider(3, range=0..10))  # -> flatten(Geometry), Transform

pt = Point(arrlinear.Geometry)

number_slider_3 = Slider(0.48, range=0..1)
box = CenterBox(Base=pt, X=number_slider_3, Y=number_slider_3, Z=number_slider_3)
debrep = DeconstructBrep(Brep=box)  # -> flatten(Faces), Edges, Vertices
area = Area(Geometry=debrep.Faces)  # -> Area, Centroid

panel = Panel("""10
13
16""")
int = Integer(panel)
item = ListItem(List=arrlinear.Geometry, Index=Slider(13, range=0..27), Wrap=True)
item_2 = ListItem(List=arrlinear.Geometry, Index=int, Wrap=True)
number_slider_4 = Slider(3, range=0..10)
yz = YZPlane(Origin=item)
box_2 = CenterBox(Base=item_2, X=number_slider_4, Y=Slider(0.3, range=0..1), Z=number_slider_4)
rotate = Rotate(Geometry=box_2, Angle=1.570796327, Plane=item)  # -> Geometry, Transform
rotate_2 = Rotate(Geometry=box_2, Angle=1.570796327, Plane=yz)  # -> Geometry, Transform

pdecon = Deconstruct(Point=area.Centroid)  # -> XComponent, YComponent, ZComponent
bnd = Bounds(Numbers=pdecon.XComponent)
bnd_2 = Bounds(Numbers=pdecon.YComponent)
bnd_3 = Bounds(Numbers=pdecon.ZComponent)
dedomain = DeconstructDomain(Domain=bnd)  # -> Start, End
dedomain_2 = DeconstructDomain(Domain=bnd_2)  # -> Start, End
dedomain_3 = DeconstructDomain(Domain=bnd_3)  # -> Start, End
srf = Surface(debrep.Faces)
mindex = MemberIndex(Set=pdecon.XComponent, Member=dedomain.Start)  # -> Index, Count
mindex_2 = MemberIndex(Set=pdecon.XComponent, Member=dedomain.End)  # -> Index, Count
mindex_3 = MemberIndex(Set=pdecon.YComponent, Member=dedomain_2.Start)  # -> Index, Count
mindex_4 = MemberIndex(Set=pdecon.YComponent, Member=dedomain_2.End)  # -> Index, Count
mindex_5 = MemberIndex(Set=pdecon.ZComponent, Member=dedomain_3.Start)  # -> Index, Count
mindex_6 = MemberIndex(Set=pdecon.ZComponent, Member=dedomain_3.End)  # -> Index, Count
merge = Merge(
    Data1=mindex.Index,
    Data2=mindex_2.Index,
    Data3=mindex_3.Index,
    Data4=mindex_4.Index,
    Data5=mindex_5.Index,
    Data6=mindex_6.Index)
cull_i = CullIndex(List=srf, Indices=merge, Wrap=True)
item_3 = ListItem(List=srf, Index=mindex.Index, Wrap=True)
item_4 = ListItem(List=srf, Index=mindex_2.Index, Wrap=True)
item_5 = ListItem(List=srf, Index=mindex_3.Index, Wrap=True)
item_6 = ListItem(List=srf, Index=mindex_4.Index, Wrap=True)
item_7 = ListItem(List=srf, Index=mindex_5.Index, Wrap=True)
item_8 = ListItem(List=srf, Index=mindex_6.Index, Wrap=True)
entwine = Entwine(
    Branch00=item_3,
    Branch01=item_4,
    Branch02=item_5,
    Branch03=item_6,
    Branch04=item_7,
    Branch05=item_8,
    Branch06=cull_i,
    FlattenInputs=True)

entwine_2 = Entwine(
    Branch00=ColourSwatch(SwatchColor=RGB(255, 255, 255)),
    Branch01=ColourSwatch(SwatchColor=RGB(0, 255, 0)),
    Branch02=ColourSwatch(SwatchColor=RGB(255, 0, 0)),
    Branch03=ColourSwatch(SwatchColor=RGB(255, 134, 0)),
    Branch04=ColourSwatch(SwatchColor=RGB(255, 255, 0)),
    Branch05=ColourSwatch(SwatchColor=RGB(0, 0, 255)),
    Branch06=ColourSwatch(SwatchColor=RGB(18, 18, 18)),
    FlattenInputs=True)

smesh = SimpleMesh(Brep=entwine)
mcol = MeshColours(Mesh=smesh, Colours=entwine_2)  # -> flatten(Mesh)

number_slider_5 = Slider(91, range=0..100)

area_2 = Area(Geometry=mcol)  # -> Area, Centroid
mindex_7 = MemberIndex(Set=area_2.Centroid, Member=area.Centroid)  # -> Index, Count
item_9 = ListItem(List=mcol, Index=mindex_7.Index, Wrap=True)
partition = PartitionList(List=flatten(item_9), Size=Slider(6, range=0..10))

mesh = Mesh(partition)
area_3 = Area(Geometry=mesh)  # -> Area, Centroid
item_10 = ListItem(List=area_3.Centroid, Index=0, Wrap=True)
item_11 = ListItem(List=area_3.Centroid, Index=Slider(2, range=0..10), Wrap=True)
addition = Addition(A=item_10, B=item_11)
division = Division(A=addition, B=Slider(2, range=0..10))

# ----
# resetGame
button = Button()

# ----
# 1) :selectBlockToRotate
number_slider_6 = Slider(5, range=0..8)

item_12 = ListItem(List=rotate_2.Geometry, Index=0, Wrap=True)  # -> Item, Item1, Item2
item_13 = ListItem(List=box_2, Index=0, Wrap=True)  # -> Item, Item1, Item2
item_14 = ListItem(List=rotate.Geometry, Index=0, Wrap=True)  # -> Item, Item1, Item2
int_2 = Integer(number_slider_6)
filter = StreamFilter(
    Gate=int_2,
    Stream0=item_12.Item,
    Stream1=item_12.Item1,
    Stream2=item_12.Item2,
    Stream3=item_13.Item,
    Stream4=item_13.Item1,
    Stream5=item_13.Item2,
    Stream6=item_14.Item,
    Stream7=item_14.Item1,
    Stream8=item_14.Item2)
preview = CustomPreview(Geometry=filter, Material=ColourSwatch(SwatchColor=RGBA(166, 218, 255, 34)))

xy = XYPlane(Origin=Point(0, 0, 0))
xz = XZPlane(Origin=Point(0, 0, 0))
yz_2 = YZPlane(Origin=Point(0, 0, 0))
cubiccenterpoint = Point(item)
filter_2 = StreamFilter(
    Gate=int_2,
    Stream0=xy,
    Stream1=xy,
    Stream2=xy,
    Stream3=xz,
    Stream4=xz,
    Stream5=xz,
    Stream6=yz_2,
    Stream7=yz_2,
    Stream8=yz_2)
pl_origin = PlaneOrigin(Base=filter_2, Origin=cubiccenterpoint)

# ----
# 3) : nextRotate
number_slider_7 = Slider(10, range=0..100)

# ----
# rotateAngle
# 2) : rotateBlock
number_slider_8 = Slider(0, range=-36..36)

mesh_2 = Mesh(simplify(mesh))
pt_2 = Point(simplify(division))
bool = Boolean(button)
int_3 = Integer(number_slider_7)
int_4 = Integer("0")
loop_start = LoopStart(N=int_3, T=bool, D0=pt_2, D1=mesh_2, D2=int_4)  # -> port, Counter, Data, Data_2, Data_3
pt_3 = Point(simplify(graft(loop_start.Data)))
mesh_3 = Mesh(simplify(loop_start.Data_2))
brep = Brep(filter)
brepinc = PointInBrep(Brep=brep, Point=pt_3, Strict=False)
mindex_8 = MemberIndex(Set=flatten(brepinc), Member=Toggle(True))  # -> graft(Index), Count
path = ConstructPath(Indices=mindex_8.Index)
split = SplitTree(Data=mesh_3, Masks=flatten(path))  # -> Positive, Negative
dispatch = Dispatch(List=pt_3, DispatchPattern=brepinc)  # -> ListA, ListB
mesh_4 = Mesh(split.Negative)
pln = Plane(pl_origin)
pt_4 = Point(dispatch.ListB)

number_slider_9 = Slider(180, range=0..1000)
num = Number(loop_start.Data_3)
neg = Negative(Value=number_slider_9)
addition_2 = Addition(A=num, B=neg)
addition_3 = Addition(A=num, B=number_slider_9)
dom = ConstructDomain(DomainStart=addition_3, DomainEnd=addition_2)
dom_2 = ConstructDomain(DomainStart=number_slider_9, DomainEnd=neg)
multiplication = Multiplication(A=Slider(10, range=0..10), B=number_slider_8)
num_2 = Number(multiplication)
remap = RemapNumbers(Value=num_2, Source=dom, Target=dom_2)  # -> Mapped, Clipped

panel_2 = Panel(remap.Mapped)

rotate_3 = Rotate(Geometry=dispatch.ListA, Angle=degrees(remap.Mapped), Plane=pln)  # -> Geometry, Transform
rotate_4 = Rotate(Geometry=split.Positive, Angle=degrees(remap.Mapped), Plane=pln)  # -> Geometry, Transform
merge_2 = Merge(Data1=rotate_3.Geometry, Data2=pt_4)
merge_3 = Merge(Data1=rotate_4.Geometry, Data2=mesh_4)
clean = CleanTree(RemoveNulls=True, RemoveInvalid=True, RemoveEmpty=invert(False), Tree=merge_2)
loop_end = LoopEnd(
    port=loop_start.port,
    Exit=False,
    Data=clean,
    Data_2=merge_3,
    Data_3=num_2,
    TimeOutVal=0,
    pausedState=False,
    state="Constant output")  # -> D0, D1, D2
